# Grasshopper definition facade_script.gh (Grasshopper 1.0.7)

mesh = Mesh([<mesh referenced from the Rhino model> x5])
Z = UnitZ(Factor=1)
crv = Curve(<curve referenced from the Rhino model>)
demesh = DeconstructMesh(Mesh=mesh)  # -> Vertices, Faces, Colours, Normals
neg = Negative(Value=Slider(-107, range=-300..400))
line = Line(Line((1288, 641, 0), (0, 641, 0)))
pline = PolyLine(Vertices=demesh.Vertices, Closed=True)
Y = UnitY(Factor=neg)
project = Project(Geometry=pline, Plane=PlaneXY(0, 0, 0))  # -> Geometry, Transform
number_slider = Slider(55, range=0..100)
neg_2 = Negative(Value=number_slider)
flip = FlipCurve(Curve=project.Geometry)  # -> Curve, Flag
flip_2 = FlipCurve(Curve=crv)  # -> Curve, Flag
crv_2 = Curve(project.Geometry)
end = EndPoints(Curve=line)  # -> Start, End
subtraction = Subtraction(A=end.End, B=end.Start)
pl = ConstructPlane(Origin=end.Start, XAxis=subtraction, YAxis=Z)
mirror = Mirror(Geometry=mesh, Plane=pl)  # -> Geometry, Transform
offset = OffsetCurve(Curve=line, Distance=neg_2, Plane=PlaneXY(0, 0, 0), Corners=1)
Z_2 = UnitZ(Factor=Slider(10, range=-100..100))
offset_2 = OffsetCurve(Curve=flip_2.Curve, Distance=number_slider, Plane=PlaneXY(0, 0, 0), Corners=1)
offset_3 = OffsetCurve(Curve=crv_2, Distance=Slider(39, range=0..100), Plane=PlaneXY(0, 0, 0), Corners=1)
end_2 = EndPoints(Curve=offset)  # -> Start, End
ln = Line(StartPoint=end.Start, EndPoint=end_2.Start)
ln_2 = Line(StartPoint=end.End, EndPoint=end_2.End)
extr = Extrude(Base=offset_3, Direction=Z_2)
extr_2 = Extrude(Base=flip_2.Curve, Direction=Z_2)
extr_3 = Extrude(Base=offset_2, Direction=Z_2)
runion = RegionUnion(Curves=offset_3)
merge = Merge(Data1=ln, Data2=ln_2, Data3=offset, Data4=line)  # -> flatten(Result)
cap = CapHoles(Brep=extr)
cap_2 = CapHoles(Brep=extr_2)
cap_3 = CapHoles(Brep=extr_3)
project_2 = Project(Geometry=merge, Plane=PlaneXY(0, 0, 0))  # -> Geometry, Transform
sdiff = SolidDifference(BrepsA=cap_2, BrepsB=cap_3)
join = JoinCurves(Curves=project_2.Geometry, Preserve=False)
filter = StreamFilter(Gate=Toggle(True), Stream1=sdiff)
extr_4 = Extrude(Base=join, Direction=Z_2)
flip_3 = FlipCurve(Curve=join)  # -> Curve, Flag
colour = ColourPicker(PickedColour=RGB(242, 191, 103))
Z_3 = UnitZ(Factor=Slider(-5, range=-100..100))
cap_4 = CapHoles(Brep=extr_4)
extr_5 = Extrude(Base=crv, Direction=Z_2)
multiplication = Multiplication(A=Z_3, B=2)
move = Move(Geometry=cap_4, Motion=Y)  # -> Geometry, Transform
filter_2 = StreamFilter(Gate=Toggle(True), Stream1=move.Geometry)
sunion = SolidUnion(Breps=flatten([cap, filter_2, filter]))
move_2 = Move(Geometry=sunion, Motion=Z_3)  # -> Geometry, Transform
cap_5 = CapHoles(Brep=extr_5)
move_3 = Move(Geometry=cap_5, Motion=multiplication)  # -> Geometry, Transform
colour_2 = ColourPicker(PickedColour=RGB(85, 124, 183))
number_slider_2 = Slider(45, range=0..100)
number_slider_3 = Slider(42, range=0..100)
number_slider_4 = Slider(100, range=0..100)
number_slider_5 = Slider(10, range=0..10)
number_slider_6 = Slider(0.09, range=0..1)
number_slider_7 = Slider(0.09, range=0..1)
number_slider_8 = Slider(0.7, range=0..1)
number_slider_9 = Slider(0.09, range=0..1)
num = Number()
num_2 = Number([0, 0.6, 0.5, 0.12, 0.35, 0.4, 0.95])
division = Division(A=1, B=number_slider_4)
series = Series(Start=0, Step=number_slider_5, Count=number_slider_4)
series_2 = Series(Start=0, Step=Slider(1, range=0..1), Count=number_slider_4)
series_3 = Series(Start=0, Step=division, Count=number_slider_4)
merge_2 = Merge(
    Data1=Slider(0, range=0..1),
    Data2=Slider(0.09, range=0..1),
    Data3=Slider(0.15, range=0..1),
    Data4=Slider(0.4, range=0..1),
    Data5=Slider(0.5, range=0..1),
    Data6=Slider(0.6, range=0..1),
    Data7=Slider(0.95, range=0..1))
item = ListItem(List=merge_2, Index=Slider(0, range=0..10), Wrap=True)
hsv = ColourHSV(Alpha=1, Hue=item, Saturation=expr("x/100", Slider(36, range=0..100)), Value=expr("x/100", Slider(67, range=0..100)))
preview = CustomPreview(Geometry=move_3.Geometry, Material=hsv)
Y_2 = UnitY(Factor=series)
division_2 = Division()
item_2 = ListItem(List=merge_2, Index=Slider(3, range=0..10), Wrap=True)
hsv_2 = ColourHSV(Alpha=1, Hue=item_2, Saturation=expr("x/100", number_slider_2), Value=expr("x/100", number_slider_3))
preview_2 = CustomPreview(Geometry=move_2.Geometry, Material=hsv_2)
hsv_3 = ColourHSV(Alpha=1, Hue=item_2, Saturation=expr("x/100", number_slider_2), Value=expr("x/100", number_slider_3))
dots = DotDisplay(Point=Y_2, Colour=hsv_3, Size=number_slider_5)
